# Grasshopper definition parametric_canopy.gh (Grasshopper 1.0.8)

# ----
# size of canopy
number_slider = Slider(10, range=0..10)

# ----
# Anchor points controls
number_slider_2 = Slider(0, range=0..90)

# ----
# Canopy Location
number_slider_3 = Slider(0, range=-10..10)

# ----
# Branch inputs
number_of_generations = Slider(4, range=0..10)
max_angle_of_branches = Slider(25, range=0..100)
length_of_branches = Slider(0.4, range=0..10)

# ----
# Seed
number_slider_4 = Slider(17, range=0..100)

# ----
# UV from surface
number_slider_5 = Slider(100, range=0..100)

# ----
# Heightmap controls
number_slider_6 = Slider(0.363, range=0..5)

# ----
# initial UV shape
dv = Slider(50, range=0..100)
du = Slider(50, range=0..100)

# ----
# SEED COMPONENT
py3 = Python3Script()  # -> out, a; disabled; unedited script template

py3_2 = Python3Script(
    dU=dv,
    dV=du,
    amp=Slider(2, range=0..5),
    frq=Slider(4, range=0..5),
    pha=number_slider_6,
    orix=number_slider_3,
    oriy=Slider(0, range=-10..10),
    oriz=Slider(2, range=-10..10),
    sizex=number_slider,
    sizey=Slider(10, range=0..10),
    anchor_rot_angle=number_slider_2,
    anchor_scale=Slider(0.42, range=0..1),
    gen=number_of_generations,
    angle=max_angle_of_branches,
    L=length_of_branches,
    seed=number_slider_4,
    U1=number_slider_5,
    V1=Slider(100, range=0..100))  # -> mesh, Lines
# ---------- py3_2: Python ----------
import numpy as np
import Rhino.Geometry as rg
import ghpythonlib.treehelpers as th
import rhinoscriptsyntax as rs
import math
import random

### anchor points from boundingbox
def boundingbox_anchor_pts(mesh):
    pts8 = rs.BoundingBox(mesh)
    pts4 = pts8[-4:]

    out_pts = []
    for pts0 in pts4:
        out_pts.append(rg.Point3d(pts0.X, pts0.Y, 0))
    
    x = sum([pt.X for pt in out_pts]) / 4.0
    y = sum([pt.Y for pt in out_pts]) / 4.0
    z = sum([pt.Z for pt in out_pts]) / 4.0

    bounds_center = rg.Point3d(x, y, z)

    anchor_pts = []

    angle_rad = math.radians(anchor_rot_angle)
    rot = rg.Transform.Rotation(angle_rad, bounds_center)

    for pt in out_pts:
        v_anchor_center = pt - bounds_center
    
        v_scaled = v_anchor_center * anchor_scale
    
        moved_pt = bounds_center + v_scaled
    
        moved_pt_rot = moved_pt
        moved_pt_rot.Transform(rot)
    
        anchor_pts.append(moved_pt_rot)
    return (anchor_pts)

### initial UV grid
def uv_grid(divU, divV):
    u = np.linspace(0.0, 1.0, divU)
    v = np.linspace(0.0, 1.0, divV)
    U, V = np.meshgrid(u, v)

    return U, V

### heightmap
def heightmap(U, V, amplitude, frequency, phase):

    # sine wave
    wave = np.sin((U * frequency + phase) * 2 * np.pi) * np.cos((V * frequency + phase) * 2 * np.pi)

    # sine ridges 
    ridges = np.abs(np.sin(5 * U * np.pi)) * 0.5

    # combining waves
    H = amplitude * (random.uniform(0.0,1.0)*wave + random.uniform(0.0,1.0)*ridges)

    return H


### initial grid of points
def make_point_grid_xy(divU, divV, origin, size):

    ox, oy, oz = origin
    sx, sy = size

    step_u = 1.0 / (divU - 1) if divU > 1 else 0
    step_v = 1.0 / (divV - 1) if divV > 1 else 0

    grid = []
    for j in range(int(divV)):
        v = j * step_v
        row = []
        for i in range(int(divU)):
            u = i * step_u

            x = ox + u * sx
            y = oy + v * sy
            row.append((x, y, oz))
        grid.append(row)

    return grid

### moving along z based on heightmap
def move_along_z(pts):
    pts_moved = [
        [
            (x, y, float(z + a[i, j]))
            for j, (x, y, z) in enumerate(row)
        ]
    for i, row in enumerate(pts)
    ]
    return pts_moved

### surface from moved points
def surface_from_point_grid(point_grid):

    rows = len(point_grid)
    cols = len(point_grid[0])

    flat_points = [pt for row in point_grid for pt in row]

    srf_id = rs.AddSrfPtGrid((rows, cols), flat_points)
    return srf_id

### uniform grid from srf
def sample_uniform_grid(surface, U, V):
    du0, du1 = rs.SurfaceDomain(surface, 0)
    dv0, dv1 = rs.SurfaceDomain(surface, 1)

    pu = [du0 + (du1 - du0)*(i/float(U)) for i in range (U+1)]
    pv = [dv0 + (dv1 - dv0)*(i/float(V)) for i in range (V+1)]

    pts = []

    for u in pu:
        row = []
        for v in pv:
            tmp_pt = rs.EvaluateSurface(surface, u, v)
            row.append(tmp_pt)
        pts.append(row)
    
    return pts

### tri mesh
def tri_mesh_from_points(pts):

    rows = len(pts)
    cols = len(pts[0])

    vertices = [pts[i][j] for i in range(rows) for j in range (cols)]

    faces = []
    vcols = cols

    for i in range(rows - 1):
        for j in range(cols - 1):
            a = i * vcols + j
            b = a + 1
            c = b + vcols
            d = c - 1

            faces.append([a, b, c])
            faces.append([a, d, c])

    mesh = rs.AddMesh(vertices, faces)
    return mesh


###branching structure
def Grow(pt, v, length, g):
    if g >= gen:
        return

    plane = rs.PlaneFromNormal(pt, v)
    random_pt = rs.EvaluatePlane(plane, [random.uniform(-1, 1), random.uniform(-1, 1)])
    rot_axis = rs.VectorCreate(random_pt, pt)

    V1 = rs.VectorRotate(v, random.uniform(-angle,0), rot_axis)
    pt1 = rs.PointAdd(pt, rs.VectorScale(V1, length))

    if g + 1 == gen:
        pt1 = rs.MeshClosestPoint(mesh, pt1)[0]

    L1 = rs.AddLine(pt, pt1)
    Lines.append(L1)

    Grow(pt1, V1, length * random.uniform(0.75,0.95), g+1)

    V2 = rs.VectorRotate(v, random.uniform(0,angle), rot_axis)
    pt2 = rs.PointAdd(pt, rs.VectorScale(V2, length))

    if g + 1 == gen:
        pt2 = rs.MeshClosestPoint(mesh, pt2)[0]

    L2 = rs.AddLine(pt, pt2)
    Lines.append(L2)

    Grow(pt2, V2, length * random.uniform(0.75,0.95), g+1)

###inputs

#U and V
dU = int(dU)
dV = int(dV)

U1 = int(U1)
V1 = int(V1)

#seed
random.seed(seed)

#size and origin of canopy
O = (orix,oriy,oriz)
S = (sizex,sizey)

#branching input
V = [0,0,1]
Lines = []


###run functions###


# UV grid
U_grid, V_grid = uv_grid(dU, dV)

# heightmap
a = heightmap(U_grid, V_grid, amp, frq, pha)

# grid of points
pts = make_point_grid_xy(dU, dV, O, S)

# moving grid points along z
pts_moved = move_along_z(pts)

# surface from moved points
srf = surface_from_point_grid(pts_moved)

# surface sampling
pts_grid_UV = sample_uniform_grid(srf, U1, V1)

# creating tri meshes
mesh = tri_mesh_from_points(pts_grid_UV)

# anchor points from boundingbox    
a_pts = boundingbox_anchor_pts(mesh)

#branching from all 4 anchor points
for A in a_pts:
    B = rs.PointAdd(A, rs.VectorScale(V, L))
    Lines.append(rs.AddLine(A, B))
    Grow(B, V, L, 0)
# ---------- end py3_2 ----------

# ----
# MESH / TESSELATE SURFACE
py3_3 = Python3Script()  # -> out, a; disabled; unedited script template

mesh = Mesh(py3_2.mesh)
crv = Curve(py3_2.Lines)

# ----
# BOUNDINGBOX FOR ANCHOR POINTS
py3_4 = Python3Script()  # -> out, a; disabled; unedited script template

# ----
# Design C internalized geometries
crv_2 = Curve([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])
mesh_2 = Mesh(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)

# ----
# Design A internalized geometries
crv_3 = Curve([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])
mesh_3 = Mesh(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)

# ----
# Design B internalized geometries
crv_4 = Curve([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])
mesh_4 = Mesh(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)

# ----
# INTERNALIZED SURFACE2
srf = Surface(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)  # disabled

# ----
# SURFACE FROM 2D GRID POINTS
py3_5 = Python3Script()  # -> out, a; disabled; unedited script template

# ----
# testing
number_slider_7 = Slider(10, range=0..100)  # disabled
py3_6 = Python3Script()  # -> out, a; disabled; unedited script template
number_slider_8 = Slider(1, range=0..1)  # disabled
number_slider_9 = Slider(0.1, range=0..1)  # disabled
number_slider_10 = Slider(0, range=0..1)  # disabled
pt = ConstructPoint(XCoordinate=0, YCoordinate=0, ZCoordinate=0)  # disabled
number_slider_11 = Slider(5, range=0..10)  # disabled
number_slider_12 = Slider(5, range=0..10)  # disabled
panel = Panel("1")  # disabled
pt_2 = ConstructPoint(XCoordinate=number_slider_11, YCoordinate=number_slider_11, ZCoordinate=0)  # disabled
pt_3 = ConstructPoint(XCoordinate=number_slider_12, YCoordinate=number_slider_12, ZCoordinate=0)  # disabled
number_slider_13 = Slider(44, range=0..100)  # disabled
number_slider_14 = Slider(3, range=0..10)  # disabled
number_slider_15 = Slider(2.916, range=0..10)  # disabled
number_slider_16 = Slider(44, range=0..100)  # disabled
number_slider_17 = Slider(3, range=0..10)  # disabled
number_slider_18 = Slider(2.916, range=0..10)  # disabled
mesh_5 = Mesh()  # disabled
py3_7 = Python3Script(gen=number_slider_14, angle=number_slider_13, L=number_slider_15)  # -> out, Lines; disabled
# ---------- py3_7: Python ----------
import rhinoscriptsyntax as rs
import random
print(A)

V = [0,0,1]
Lines = []

def Grow(pt, v, length, g):
    if g >= gen:
        return

    plane = rs.PlaneFromNormal(pt, v)
    random_pt = rs.EvaluatePlane(plane, [random.uniform(-1, 1), random.uniform(-1, 1)])
    rot_axis = rs.VectorCreate(random_pt, pt)

    # ----- branch 1 -----
    V1 = rs.VectorRotate(v, random.uniform(-angle,0), rot_axis)
    pt1 = rs.PointAdd(pt, rs.VectorScale(V1, length))

    # If next generation is final → snap endpoint to canopy mesh
    if g + 1 == gen:
        pt1 = rs.MeshClosestPoint(mesh, pt1)[0]

    L1 = rs.AddLine(pt, pt1)
    Lines.append(L1)

    # recurse normally
    Grow(pt1, V1, length * random.uniform(0.75,0.95), g+1)

    # ----- branch 2 -----
    V2 = rs.VectorRotate(v, random.uniform(0,angle), rot_axis)
    pt2 = rs.PointAdd(pt, rs.VectorScale(V2, length))

    if g + 1 == gen:
        pt2 = rs.MeshClosestPoint(mesh, pt2)[0]

    L2 = rs.AddLine(pt, pt2)
    Lines.append(L2)

    Grow(pt2, V2, length * random.uniform(0.75,0.95), g+1)

random.seed(5)

B = rs.PointAdd(A, rs.VectorScale(V, L))
Lines.append(rs.AddLine(A, B))

Grow(B, V, L, 0)

print(A)
# ---------- end py3_7 ----------
py3_8 = Python3Script(gen=number_slider_17, angle=number_slider_16, L=number_slider_18, A=pt_3, mesh=mesh_5)  # -> out, Lines; disabled
# ---------- py3_8: Python ----------
import rhinoscriptsyntax as rs
import random


V = [0,0,1]
Lines = []

def Grow(pt, v, length, g):
    if g >= gen:
        return

    plane = rs.PlaneFromNormal(pt, v)
    random_pt = rs.EvaluatePlane(plane, [random.uniform(-1, 1), random.uniform(-1, 1)])
    rot_axis = rs.VectorCreate(random_pt, pt)

    # ----- branch 1 -----
    V1 = rs.VectorRotate(v, random.uniform(-angle,0), rot_axis)
    pt1 = rs.PointAdd(pt, rs.VectorScale(V1, length))

    # If next generation is final → snap endpoint to canopy mesh
    if g + 1 == gen:
        pt1 = rs.MeshClosestPoint(mesh, pt1)[0]

    L1 = rs.AddLine(pt, pt1)
    Lines.append(L1)

    # recurse normally
    Grow(pt1, V1, length * random.uniform(0.75,0.95), g+1)

    # ----- branch 2 -----
    V2 = rs.VectorRotate(v, random.uniform(0,angle), rot_axis)
    pt2 = rs.PointAdd(pt, rs.VectorScale(V2, length))

    if g + 1 == gen:
        pt2 = rs.MeshClosestPoint(mesh, pt2)[0]

    L2 = rs.AddLine(pt, pt2)
    Lines.append(L2)

    Grow(pt2, V2, length * random.uniform(0.75,0.95), g+1)

random.seed(5)

B = rs.PointAdd(A, rs.VectorScale(V, L))
Lines.append(rs.AddLine(A, B))

Grow(B, V, L, 0)
# ---------- end py3_8 ----------

# ----
# 2D GRID OF POINTS
py3_9 = Python3Script(dU=number_slider_7, dV=number_slider_7)  # -> simplify(pts_tree), pts; disabled
# ---------- py3_9: Python ----------
import numpy as np
import Rhino.Geometry as rg
import ghpythonlib.treehelpers as th


def make_point_grid_xy(divU, divV, origin=(0.0, 0.0, 0.0), size=(10.0, 10.0)):
    """Create a simple planar XY grid of points as a fallback when no surface exists.
    
    Parameters
    ----------
    divU : int
        Number of divisions in the U direction (columns).
    divV : int
        Number of divisions in the V direction (rows).
    origin : tuple(float, float, float)
        Base XYZ location of the grid.
    size : tuple(float, float)
        Physical size of the grid in X and Y directions.

    Returns
    -------
    list[list[tuple]]
        2D list-of-lists representing the grid of XYZ points.
    """
    ox, oy, oz = origin
    sx, sy = size

    # Step increments in UV space
    step_u = 1.0 / (divU - 1) if divU > 1 else 0
    step_v = 1.0 / (divV - 1) if divV > 1 else 0

    grid = []
    for j in range(int(divV)):
        v = j * step_v
        row = []
        for i in range(int(divU)):
            u = i * step_u
            # Map UV → XY
            x = ox + u * sx
            y = oy + v * sy
            row.append((x, y, oz))
        grid.append(row)

    return grid
# --- Create the grid of points ---

O = (0.0,0.0,10.0)
S = (10.0,10.0)
pts = make_point_grid_xy(dU, dV, O, S)

pts_tree = th.list_to_tree(pts)
print(pts)
# ---------- end py3_9 ----------

# ----
# U, V GRID PLACEHOLDER
py3_10 = Python3Script(dU=number_slider_7, dV=number_slider_7)  # -> out, flatten(a_tree); disabled
# ---------- py3_10: Python ----------
import numpy as np
import Rhino.Geometry as rg
import ghpythonlib.treehelpers as th


dU = int(dU)
dV = int(dV)

def uv_grid(divU, divV):
    u = np.linspace(0.0, 1.0, divU)
    v = np.linspace(0.0, 1.0, divV)
    U, V = np.meshgrid(u, v)

    return U, V



a = uv_grid(dU, dV)
a_tree = th.list_to_tree(a)
# ---------- end py3_10 ----------

# ----
# Branch Component
number_slider_19 = Slider(5, range=0..10)  # disabled
number_slider_20 = Slider(41, range=0..100)  # disabled
number_slider_21 = Slider(1, range=0..10)  # disabled
py3_11 = Python3Script(gen=number_slider_19, angle=number_slider_20, L=number_slider_21, A=pt)  # -> out, Lines; disabled
# ---------- py3_11: Python ----------
import rhinoscriptsyntax as rs
import random
V = [0,0,1]

Lines = []

def Grow(pt, v, len, g):
    if(g < gen):
        plane = rs.PlaneFromNormal(pt, v)
        random_pt = rs.EvaluatePlane(plane, [random.uniform(-1, 1),random.uniform(-1, 1)])
        rot_axis = rs.VectorCreate(random_pt, pt)

        V1 = rs.VectorRotate(v, random.uniform(-angle,0), rot_axis)
        pt1 = rs.PointAdd(pt, rs.VectorScale(V1, len))
        V2 = rs.VectorRotate(v, random.uniform(0,angle), rot_axis)
        pt2 = rs.PointAdd(pt, rs.VectorScale(V2, len))

        L1 = rs.AddLine(pt, pt1)
        L2 = rs.AddLine(pt, pt2)

        Lines.append(L1)
        Lines.append(L2)
        Grow(pt1, V1, len*random.uniform(0.75,0.95), g+1)
        Grow(pt2, V2, len*random.uniform(0.75,0.95), g+1)
random.seed(5)
B = rs.PointAdd(A, rs.VectorScale(V,L))
Lines.append(rs.AddLine(A,B))



A = Grow(B, V, L, 0)
# ---------- end py3_11 ----------

# ----
# HEIGHTMAP FUNCTION
py3_12 = Python3Script(dU=number_slider_7, dV=number_slider_7, amp=number_slider_8, frq=number_slider_9, pha=number_slider_10)  # -> out, a, a_tree, a_list; disabled
# ---------- py3_12: Python ----------
import numpy as np
import Rhino.Geometry as rg
import ghpythonlib.treehelpers as th


dU = int(dU)
dV = int(dV)

def uv_grid(divU, divV):
    u = np.linspace(0.0, 1.0, divU)
    v = np.linspace(0.0, 1.0, divV)
    U, V = np.meshgrid(u, v)

    return U, V

U_grid, V_grid = uv_grid(dU, dV)

a = uv_grid(dU, dV)
a_tree = th.list_to_tree(a)
def heightmap(U, V, amplitude=1.0, frequency=1.0, phase=0.0):
    """Compute a scalar height field H over U,V using vectorized NumPy operations."""

    # --- 1) Basic sinusoidal waves ---
    wave = np.sin((U * frequency + phase) * 2 * np.pi) * \
           np.cos((V * frequency + phase) * 2 * np.pi)

    # --- 2) Radial attractor centered at (0.5, 0.5) ---
    cx, cy = 0.5, 0.5
    R = np.sqrt((U - cx)**2 + (V - cy)**2)
    radial = np.exp(-10 * R)  # sharp falloff

    # --- 3) Ridges (absolute sine) ---
    ridges = np.abs(np.sin(5 * U * np.pi)) * 0.5

    # --- 4) Fake "noise" using summed trigs (GH-safe alternative to Perlin) ---
    noise = (
        0.5 * np.sin(3*U*2*np.pi + 2*V*np.pi) +
        0.25 * np.cos(5*U*2*np.pi - 3*V*np.pi) +
        0.125 * np.sin(9*(U+V)*np.pi)
    )

    # --- Combine fields ---
    H = amplitude * (0.5*wave + 0.3*radial + 0.4*ridges + 0.3*noise)

    return H


a = heightmap(U_grid, V_grid, amp, frq, pha)

a_tree = th.list_to_tree(a)

print (a)
print (a_tree)


a_list = a.tolist()  # now it's a list of lists

# Convert to DataTree
a_tree = th.list_to_tree(a_list)
# ---------- end py3_12 ----------

panel_2 = Panel(py3_9.pts_tree)  # disabled
panel_3 = Panel(py3_9.pts)  # disabled
item = ListItem(List=py3_9.pts_tree, Index=0, Wrap=True)  # -> Item, Item1, Item2; disabled
flatten = FlattenTree(Tree=panel_2, Path="{0}")  # disabled
crv_5 = Curve(py3_11.Lines)  # disabled
panel_4 = Panel(py3_12.a_list)  # disabled
panel_5 = Panel(py3_12.a_tree)  # disabled
graft = GraftTree(Tree=panel_5, IncludeEmptyLists=True, IncludeNullItems=True)  # disabled
panel_6 = Panel(graft)  # disabled
simplify = SimplifyTree(Tree=panel_6, Front=False)  # disabled
panel_7 = Panel(simplify)  # disabled
panel_8 = Panel(py3_12.a)  # disabled
addition = Addition(A=item.Item2, B=panel_7)  # disabled
pt_4 = ConstructPoint(XCoordinate=item.Item, YCoordinate=item.Item1, ZCoordinate=addition)  # disabled

# ----
# MANIPULATE 2D GRID POINTS
py3_13 = Python3Script(pts=panel_2)  # -> out, pts; disabled
# ---------- py3_13: Python ----------
print(pts)
# ---------- end py3_13 ----------
