# Grasshopper definition Assignment_4.gh (Grasshopper 1.0.8)

# ---- group: Surface Creator / Surface Controls
number_slider = Slider(1, range=0..10)  # disabled
number_slider_2 = Slider(1, range=0..10)  # disabled
number_slider_3 = Slider(5, range=0..10)  # disabled

# ---- group: Surface Creator / UV division
number_slider_4 = Slider(50, range=0..100)  # disabled
number_slider_5 = Slider(50, range=0..100)  # disabled

# ---- group: Surface Creator / Surface Origin
number_slider_6 = Slider(0, range=0..100)  # disabled
number_slider_7 = Slider(0, range=0..100)  # disabled
number_slider_8 = Slider(0, range=0..100)  # disabled

# ---- group: Surface Creator / size
number_slider_9 = Slider(50, range=0..100)  # disabled
number_slider_10 = Slider(50, range=0..100)  # disabled

# ----
trigger = Trigger(Interval=50, TimerInterval=50, Target=py3)
srf = Surface(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)
py3 = Python3Script(
    srf=srf,
    N=Slider(10, range=0..1000),
    force_intensity=Slider(0.005, range=0..0.1),
    neighbor_count=Slider(3, range=0..10),
    reset=Button(),
    Seed=Slider(42, range=0..100))  # -> out, A, P, T, TrailPoints, SlopeValues; inputs srf: Surface, N: Int32, force_intensity: Double, neighbor_count: Int32, reset: Boolean, Seed: Int32
# ---------- py3: Python ----------
import scriptcontext as sc
import rhinoscriptsyntax as rs
import random
import numpy as np
import Rhino.Geometry as rg

# -----------------------------------------------------------------------------
# Seed
# -----------------------------------------------------------------------------
np.random.seed(Seed)
random.seed(Seed)
# -----------------------------------------------------------------------------
# Agent class
# -----------------------------------------------------------------------------
class Agent:
    def __init__(self, srf, position):
        self.Position = position  # UV in [0,1]
        self.velocity = [0, 0, 0]
        self.srf = srf
        self.local_curvature = 1
        self.point = []  
        self.alive = True

    def dist(self, agent):
        curvature_factor = np.interp(agent.local_curvature, [-0.015, 0.015], [1, 5])
        return rs.Distance(self.Position, agent.Position) * curvature_factor

    def sorted_neighbors(self, agents):
        return sorted(agents, key=self.dist)

    def separation(self, agents, force_intensity, n):
        self.velocity = [0, 0, 0]
        sorted_neighbors = self.sorted_neighbors(agents)

        for i in range(min(n, len(sorted_neighbors))):
            agent = sorted_neighbors[i]
            if agent == self:
                continue

            distance_vec = rs.VectorCreate(self.Position, agent.Position)
            if rs.VectorLength(distance_vec) == 0:
                distance_vec = [random.uniform(-1, 1),
                                random.uniform(-1, 1),
                                0]

            inverse_dist = np.interp(
                rs.VectorLength(distance_vec),
                [0, 1],
                [force_intensity, 0]
            )

            inverse_distance_vec = rs.VectorUnitize(distance_vec)
            inverse_distance_vec = rs.VectorScale(inverse_distance_vec, inverse_dist)

            self.velocity = rs.VectorAdd(self.velocity, inverse_distance_vec)

    def check_if_dead(self):
        u, v = self.Position[0], self.Position[1]

        if u <= 0 or u >= 1 or v <= 0 or v >= 1:
            self.alive = False

    def update(self):

        if not self.alive:
            return

        self.Position = rs.VectorAdd(self.Position, self.velocity)
        self.Position = np.clip(list(self.Position), 0, 1).tolist()

        scaled_u = self.Position[0] * rs.SurfaceDomain(self.srf, 0)[1]
        scaled_v = self.Position[1] * rs.SurfaceDomain(self.srf, 1)[1]

        pt3d = rs.EvaluateSurface(self.srf, scaled_u, scaled_v)

        self.point.append(pt3d)

        scaled_u = self.Position[0] * rs.SurfaceDomain(self.srf, 0)[1]
        scaled_v = self.Position[1] * rs.SurfaceDomain(self.srf, 1)[1]
        self.local_curvature = rs.SurfaceCurvature(self.srf, (scaled_u, scaled_v))[6]



# -----------------------------------------------------------------------------
# Build agents function
# -----------------------------------------------------------------------------
def build_agents(srf, num_agents):
    agents = []
    for _ in range(num_agents):
        u = random.uniform(0, 1)
        v = random.uniform(0, 1)
        point = [u, v]
        ag = Agent(srf, point)
        agents.append(ag)
    return agents


# -----------------------------------------------------------------------------
# Persistent agent storage
# -----------------------------------------------------------------------------
if reset or "agents" not in sc.sticky:
    sc.sticky["agents"] = build_agents(srf, N)

agents = sc.sticky["agents"]


for ag in agents:
    if ag.alive:
        ag.separation(agents, force_intensity, neighbor_count)

for ag in agents:
    ag.update()
    ag.check_if_dead()

# -----------------------------------------------------------------------------
# Visualization
# -----------------------------------------------------------------------------

P = []           
T = []           
TrailPoints = [] 
SlopeValues = []

vertical = rg.Vector3d(0, 0, 1)

for ag in agents:

    if ag.alive:
        u = ag.Position[0] * rs.SurfaceDomain(srf, 0)[1]
        v = ag.Position[1] * rs.SurfaceDomain(srf, 1)[1]
        pt3d = rs.EvaluateSurface(srf, u, v)
        P.append(pt3d)


    if len(ag.point) > 1:
        poly = rg.Polyline(ag.point)
        T.append(rg.PolylineCurve(poly))

        for p in ag.point:
            TrailPoints.append(p)

            uv = rs.SurfaceClosestPoint(srf, p)
            if uv:
                normal = rs.SurfaceNormal(srf, uv)
                if normal:
                    angle = rg.Vector3d.VectorAngle(normal, vertical)
                    SlopeValues.append(angle)
                else:
                    SlopeValues.append(0.0)
            else:
                SlopeValues.append(0.0)

sc.sticky["agents"] = agents
# ---------- end py3 ----------

# ---- group: Surface Creator
py3_2 = Python3Script(
    dU=number_slider_4,
    dV=number_slider_5,
    amp=number_slider_3,
    frq=number_slider_2,
    pha=number_slider,
    orix=number_slider_7,
    oriy=number_slider_6,
    oriz=number_slider_8,
    sizex=number_slider_9,
    sizey=number_slider_10)  # -> srf; inputs dU: Int32, dV: Int32; disabled
# ---------- py3_2: Python ----------
#libraries
import numpy as np
import Rhino.Geometry as rg
import ghpythonlib.treehelpers as th
import rhinoscriptsyntax as rs
import math
import random

O = (orix,oriy,oriz)
S = (sizex,sizey)

### initial UV grid
def uv_grid(divU, divV):
    u = np.linspace(0.0, 1.0, divU)
    v = np.linspace(0.0, 1.0, divV)
    U, V = np.meshgrid(u, v)

    return U, V

### heightmap
def heightmap(U, V, amplitude, frequency, phase):

    # sine wave
    wave = np.sin((U * frequency + phase) * 2 * np.pi) * np.cos((V * frequency + phase) * 2 * np.pi)

    # sine ridges 
    ridges = np.abs(np.sin(5 * U * np.pi)) * 0.5

    # combining waves
    H = amplitude * (random.uniform(0.0,1.0)*wave + random.uniform(0.0,1.0)*ridges)

    return H

### rectangular grid of points
def make_point_grid_xy(divU, divV, origin, size):

    ox, oy, oz = origin
    sx, sy = size

    step_u = 1.0 / (divU - 1) if divU > 1 else 0
    step_v = 1.0 / (divV - 1) if divV > 1 else 0

    grid = []
    for j in range(int(divV)):
        v = j * step_v
        row = []
        for i in range(int(divU)):
            u = i * step_u

            x = ox + u * sx
            y = oy + v * sy
            row.append((x, y, oz))
        grid.append(row)

    return grid

### moving along z based on heightmap
def move_along_z(pts):
    pts_moved = [
        [
            (x, y, float(z + a[i, j]))
            for j, (x, y, z) in enumerate(row)
        ]
    for i, row in enumerate(pts)
    ]
    return pts_moved

### surface from moved points
def surface_from_point_grid(point_grid):

    rows = len(point_grid)
    cols = len(point_grid[0])

    flat_points = [pt for row in point_grid for pt in row]

    srf_id = rs.AddSrfPtGrid((rows, cols), flat_points)
    return srf_id


# UV grid
U_grid, V_grid = uv_grid(dU, dV)

# heightmap
a = heightmap(U_grid, V_grid, amp, frq, pha)

# grid of points
pts = make_point_grid_xy(dU, dV, O, S)

# moving grid points along z
pts_moved = move_along_z(pts)

# surface from moved points
srf = surface_from_point_grid(pts_moved)
# ---------- end py3_2 ----------

# ---- group: spare surface
srf_2 = Surface(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)  # disabled

# ----
num = Number(py3.SlopeValues)
crv = Curve(py3.T)
bnd = Bounds(Numbers=num)
remap = RemapNumbers(Value=py3.SlopeValues, Source=bnd, Target=Domain(0, 1))  # -> Mapped, Clipped
pt = Point(py3.TrailPoints)
pt_2 = Point(py3.P)
gradient = Gradient(LowerLimit=0, UpperLimit=1, Parameter=remap.Mapped, stops=[0: RGB(0, 128, 0), 0.5: RGB(255, 255, 0), 1: RGB(255, 0, 0)])
preview = CustomPreview(Geometry=pt, Material=gradient)
